# Grasshopper definition brown_test.gh (Grasshopper 1.0.7)
# plug-ins: TableUiAdapter, Human

trigger = Trigger(Interval=50, TimerInterval=50, Target=tableuiadaptercomponent)  # disabled
tableuiadaptercomponent = TableUiAdapterComponent(Run=Toggle(False))  # -> Pitch, Depth, CameraRotation, CameraLocation
c_script = CSharpScript(incomingData=tableuiadaptercomponent.Pitch)  # -> out, outgoingData; inputs incomingData: Point3d
# ---------- c_script: C# ----------
    if (incomingData == null)
    {
      outgoingData = savedData;
    }
    else
    {
      outgoingData = incomingData;
      savedData = incomingData;
    }
# ---------- c_script: C# additional code ----------
  private Point3d savedData;
# ---------- end c_script ----------
c_script_2 = CSharpScript(incomingData=tableuiadaptercomponent.Depth)  # -> out, outgoingData; inputs incomingData: Point3d; same code as c_script
panel = Panel(tableuiadaptercomponent.CameraLocation)
panel_2 = Panel(tableuiadaptercomponent.CameraRotation)
modify_viewport = ModifyViewport(CameraLocation=c_script.outgoingData, CameraTarget=c_script_2.outgoingData, AnimateRestore=False, RestoreFrames=10)
