# Grasshopper definition gh_testSite.gh (Grasshopper 1.0.7)
# plug-ins: TableUI

panel = Panel("[{\"1\":{\"id\":1,\"location\":[804,42],\"rotation\":0},\"2\":{\"id\":2,\"location\":[542,281],\"rotation\":0},\"3\":{\"id\":3,\"location\":[622,239],\"rotation\":0},\"4\":{\"id\":4,\"location\":[699,197],\"rotation\":0},\"5\":{\"id\":5,\"location\":[774,149],\"rotation\":0},\"6\":{\"id\":6,\"location\":[847,90],\"rotation\":0},\"7\":{\"id\":7,\"location\":[577,343],\"rotation\":0},\"8\":{\"id\":8,\"location\":[658,298],\"rotation\":0},\"9\":{\"id\":9,\"location\":[739,253],\"rotation\":0},\"10\":{\"id\":10,\"location\":[817,202],\"rotation\":0},\"11\":{\"id\":11,\"location\":[894,141],\"rotation\":0},\"47\":{\"id\":47,\"location\":[451,116],\"rotation\":0},\"48\":{\"id\":48,\"location\":[523,77],\"rotation\":0},\"49\":{\"id\":49,\"location\":[594,39],\"rotation\":0},\"52\":{\"id\":52,\"location\":[480,168],\"rotation\":0},\"53\":{\"id\":53,\"location\":[554,127],\"rotation\":0},\"54\":{\"id\":54,\"location\":[627,89],\"rotation\":0},\"57\":{\"id\":57,\"location\":[510,223],\"rotation\":0},\"58\":{\"id\":58,\"location\":[586,181],\"rotation\":0},\"59\":{\"id\":59,\"location\":[662,142],\"rotation\":0},\"60\":{\"id\":60,\"location\":[736,101],\"rotation\":0}}]")

# ---- group: dynamically generate a 6:9 base plane to scale transforms on
# TODO Make a scalable 2d object that controls the limits of the objects moving
number_slider = Slider(0, range=0..100)
vec = VectorXYZ(XComponent=number_slider, YComponent=Slider(0, range=0..100), ZComponent="0")  # -> Vector, Length
pt = Point(vec.Vector)

# ---- group: dynamically assign models IDs
# TODO Assign a marker to each geometry
brep = Brep([<brep referenced from the Rhino model> x3])
graft = GraftTree(Tree=brep, IncludeEmptyLists=True, IncludeNullItems=True)
panel_2 = Panel(graft)
item = TreeItem(Tree=graft, Path="{0;1}", Index="0", Wrap=True)

# ----
pln = Plane()

# ---- group: Get JSON data from Firebase database
panel_3 = Panel("https://magpietable-default-rtdb.firebaseio.com/.json")
trigger = Trigger(Interval=5, TimerInterval=5, Target=http_get)  # disabled
toggle = BooleanToggle(True)

# ----
http_get = HttpGetAsync(URL=panel_3, Send=toggle, Expire=1000)

# ---- group: Get JSON data from Firebase database (continued)
panel_4 = Panel(http_get)

# ----
parse = ParseJson(JSON=http_get)  # -> IDs, Position, Rotation
panel_5 = Panel(parse.IDs)
panel_6 = Panel(parse.Position)
panel_7 = Panel(parse.Rotation)
move = Move(Geometry=item, Motion=parse.Position)  # -> Geometry, Transform
brep_2 = Brep(move.Geometry)
pt_2 = Point(panel_6)
