# Grasshopper definition gh_testSite_benchmark.gh (Grasshopper 1.0.7)
# plug-ins: TableUI, Firefly.X, Firefly.Core

# ---- group: UDP speed test
udp_listener = UDPListener(Port="5005")
panel = Panel(udp_listener)
parse = ParseJson(JSON=udp_listener)  # -> IDs, Position, Rotation
panel_2 = Panel(parse.IDs)
panel_3 = Panel(parse.Position)
panel_4 = Panel(parse.Rotation)
pt = Point(parse.Position)
box_scale = Slider(1, range=0..2)
multiplication = Multiplication(A=box_scale, B="50")
origin_points = Deconstruct()  # -> expr("x-100", XComponent), expr("x-100", YComponent), ZComponent
division = Division(A=multiplication, B="2")
multiplication_2 = Multiplication(A="2", B=division)
subtraction = Subtraction(A=origin_points.XComponent, B=division)
subtraction_2 = Subtraction(A=origin_points.YComponent, B=division)
addition = Addition(A=division, B=origin_points.XComponent)
addition_2 = Addition(A=division, B=origin_points.YComponent)
addition_3 = Addition(A=multiplication_2, B=origin_points.ZComponent)
addition_4 = Addition(A=multiplication_2, B=origin_points.ZComponent)
addition_5 = Addition(A=division, B=origin_points.XComponent)
subtraction_3 = Subtraction(A=origin_points.YComponent, B=division)
corner_x = ConstructPoint(XCoordinate=subtraction, YCoordinate=subtraction_2, ZCoordinate=origin_points.ZComponent)
corner_z = ConstructPoint(XCoordinate=addition, YCoordinate=addition_2, ZCoordinate=addition_3)
origin_z = ConstructPoint(XCoordinate=origin_points.XComponent, YCoordinate=origin_points.YComponent, ZCoordinate=addition_4)
origin = ConstructPoint(XCoordinate=origin_points.XComponent, YCoordinate=origin_points.YComponent, ZCoordinate=origin_points.ZComponent)
pt_2 = ConstructPoint(XCoordinate=addition_5, YCoordinate=subtraction_3, ZCoordinate=origin_points.ZComponent)
box = Box2Pt(PointA=corner_x, PointB=corner_z, Plane=PlaneXY(0, 0, 0))
vec2pt = Vector2Pt(PointA=origin_z, PointB=origin, Unitize=False)  # -> Vector, Length
ln = Line(StartPoint=origin_z, EndPoint=origin)
twist = Twist(Geometry=box, Axis=ln, Angle=1.570796327, Infinite=False, Rigid=False)
udp = Curve([<curve referenced from the Rhino model> x5])
preview = CustomPreview(
    Geometry=twist,
    Material={diffuse=RGB(221, 160, 221), emission=RGB(66, 48, 66), shine=0.5, specular=RGB(255, 255, 255), transparency=0})
contour = Contour(Shape=twist, Point=origin, Direction=vec2pt.Vector, Distance="10")
move = Move(Geometry=udp, Motion=pt_2)  # -> Geometry, Transform
boundary = BoundarySurfaces(Edges=contour)
panel_5 = Panel(contour)

# ----
trigger = Trigger(Interval=10, TimerInterval=10, Target=udp_listener)
toggle = BooleanToggle(False)
# Can't get to work. Doesn't detect Reactivision on port 3333 or 7110
srf = Surface(<surface referenced from the Rhino model>)
reactivision = ReacTIVisionListener(
    BaseSurface=srf,
    StartStopListener=Toggle(True),
    BasePlaneScale=Slider(1, range=0..1),
    DrawFiducialIDMarkersTags=toggle,
    DrawBoundingBox=toggle)  # -> OrientedPlanes, FiducialID, ListenerMessage
panel_6 = Panel(reactivision.OrientedPlanes)
panel_7 = Panel(reactivision.FiducialID)
panel_8 = Panel(reactivision.ListenerMessage)
panel_9 = Panel("""O(0.19,0.15,0.00) Z(0.00,0.00,1.00)
O(0.28,0.38,0.00) Z(0.00,0.00,1.00)
O(0.15,0.32,0.00) Z(0.00,0.00,1.00)
O(0.32,0.21,0.00) Z(0.00,0.00,1.00)
O(0.36,0.59,0.00) Z(0.00,0.00,1.00)
O(0.23,0.54,0.00) Z(0.00,0.00,1.00)
O(0.40,0.43,0.00) Z(0.00,0.00,1.00)
O(0.44,0.27,0.00) Z(0.00,0.00,1.00)
O(0.48,0.11,0.00) Z(0.00,0.00,1.00)
O(0.11,0.48,0.00) Z(0.00,0.00,1.00)""")
pt_3 = Point(reactivision.OrientedPlanes)

# ---- group: HTTP Firebase speed test / Get JSON data from Firebase database
panel_10 = Panel("https://magpietable-default-rtdb.firebaseio.com/.json")
toggle_2 = BooleanToggle(True)

# ---- group: HTTP Firebase speed test
trigger_2 = Trigger(Interval=10, TimerInterval=10, Target=http_get)  # disabled
http_get = HttpGetAsync(URL=panel_10, Send=toggle_2, Expire=1000)  # disabled
parse_2 = ParseJson(JSON=http_get)  # -> IDs, Position, Rotation; disabled
panel_11 = Panel(parse_2.IDs)
panel_12 = Panel(parse_2.Rotation)
panel_13 = Panel(parse_2.Position)
box_scale_2 = Slider(1, range=0..2)
origin_2 = Point(panel_13)  # disabled
multiplication_3 = Multiplication(A=box_scale_2, B="50")
division_2 = Division(A=multiplication_3, B="2")
origin_points_2 = Deconstruct()  # -> expr("x+100", XComponent), expr("x+100", YComponent), ZComponent
multiplication_4 = Multiplication(A="2", B=division_2)
subtraction_4 = Subtraction(A=origin_points_2.XComponent, B=division_2)
subtraction_5 = Subtraction(A=origin_points_2.YComponent, B=division_2)
addition_6 = Addition(A=division_2, B=origin_points_2.XComponent)
addition_7 = Addition(A=division_2, B=origin_points_2.YComponent)
addition_8 = Addition(A=multiplication_4, B=origin_points_2.ZComponent)
addition_9 = Addition(A=multiplication_4, B=origin_points_2.ZComponent)
addition_10 = Addition(A=division_2, B=origin_points_2.XComponent)
subtraction_6 = Subtraction(A=origin_points_2.YComponent, B=division_2)
corner_x_2 = ConstructPoint(XCoordinate=subtraction_4, YCoordinate=subtraction_5, ZCoordinate=origin_points_2.ZComponent)
corner_z_2 = ConstructPoint(XCoordinate=addition_6, YCoordinate=addition_7, ZCoordinate=addition_8)
origin_z_2 = ConstructPoint(XCoordinate=origin_points_2.XComponent, YCoordinate=origin_points_2.YComponent, ZCoordinate=addition_9)
origin_3 = ConstructPoint(XCoordinate=origin_points_2.XComponent, YCoordinate=origin_points_2.YComponent, ZCoordinate=origin_points_2.ZComponent)
pt_4 = ConstructPoint(XCoordinate=addition_10, YCoordinate=subtraction_6, ZCoordinate=origin_points_2.ZComponent)
box_2 = Box2Pt(PointA=corner_x_2, PointB=corner_z_2, Plane=PlaneXY(0, 0, 0))
vec2pt_2 = Vector2Pt(PointA=origin_z_2, PointB=origin_3, Unitize=False)  # -> Vector, Length
ln_2 = Line(StartPoint=origin_z_2, EndPoint=origin_3)
twist_2 = Twist(Geometry=box_2, Axis=ln_2, Angle=1.570796327, Infinite=False, Rigid=False)
contour_2 = Contour(Shape=twist_2, Point=origin_3, Direction=vec2pt_2.Vector, Distance="10")
firebase_text = Curve([<curve referenced from the Rhino model> x13])
boundary_2 = BoundarySurfaces(Edges=contour_2)
panel_14 = Panel(contour_2)
move_2 = Move(Geometry=firebase_text, Motion=pt_4)  # -> Geometry, Transform

# ---- group: HTTP Firebase speed test / Get JSON data from Firebase database (continued)
# Nulls keep appearing. Why?
# - Not related to a specific marker or index
panel_15 = Panel(http_get)
