# Grasshopper definition gh_testSite_decoupling.gh (Grasshopper 1.0.7)
# plug-ins: TableUI

box_scale = Slider(1, range=0..2)
pt = Point(Point(0, 0, 0))
multiplication = Multiplication(A=box_scale, B="50")
division = Division(A=multiplication, B="2")
origin_points = Deconstruct(Point=pt)  # -> XComponent, YComponent, ZComponent
multiplication_2 = Multiplication(A="2", B=division)
tableui = TableUIGH_Adapter(URL="https://magpietable-default-rtdb.firebaseio.com/.json", Run=Toggle(True), Expire=1000)  # -> Points, Test
subtraction = Subtraction(A=origin_points.XComponent, B=division)
subtraction_2 = Subtraction(A=origin_points.YComponent, B=division)
addition = Addition(A=division, B=origin_points.XComponent)
addition_2 = Addition(A=division, B=origin_points.YComponent)
addition_3 = Addition(A=multiplication_2, B=origin_points.ZComponent)
addition_4 = Addition(A=multiplication_2, B=origin_points.ZComponent)
panel = Panel(tableui.Points)
panel_2 = Panel(tableui.Test)
pt_2 = Point(tableui.Points)
corner_x = ConstructPoint(XCoordinate=subtraction, YCoordinate=subtraction_2, ZCoordinate=origin_points.ZComponent)
corner_z = ConstructPoint(XCoordinate=addition, YCoordinate=addition_2, ZCoordinate=addition_3)
origin_z = ConstructPoint(XCoordinate=origin_points.XComponent, YCoordinate=origin_points.YComponent, ZCoordinate=addition_4)
origin = ConstructPoint(XCoordinate=origin_points.XComponent, YCoordinate=origin_points.YComponent, ZCoordinate=origin_points.ZComponent)
box = Box2Pt(PointA=corner_x, PointB=corner_z, Plane=PlaneXY(0, 0, 0))
vec2pt = Vector2Pt(PointA=origin_z, PointB=origin, Unitize=False)  # -> Vector, Length
ln = Line(StartPoint=origin_z, EndPoint=origin)
move = Move(Geometry=box, Motion=pt_2)  # -> Geometry, Transform
