# Grasshopper definition gh_testSite_models.gh (Grasshopper 1.0.7)
# plug-ins: TableUiAdapter

panel = Panel("C:\\Users\\nshikada\\Documents\\GitHub\\table\\src\\tb-detection\\")
brep = Brep([<brep referenced from the Rhino model> x4])
trigger = Trigger(Interval=50, TimerInterval=50, Target=tableuiadaptercomponent)  # disabled
tableuiadaptercomponent = TableUiAdapterComponent(Run=Toggle(True), DetectionPath=panel, Models=brep, Variables=Slider(3, range=0..10))  # -> Models, Variables

# ---- group: change the color according to the variable
construct_domain = ConstructDomain(DomainStart="0", DomainEnd="180")
construct_domain_2 = ConstructDomain(DomainStart="0", DomainEnd="255")
list_item = ListItem(List=tableuiadaptercomponent.Variables, Index="2", Wrap=True)
remap_numbers = RemapNumbers(Value=list_item, Source=construct_domain, Target=construct_domain_2)  # -> Mapped, Clipped

construct_domain_3 = ConstructDomain(DomainStart="0", DomainEnd="180")
construct_domain_4 = ConstructDomain(DomainStart="-100", DomainEnd="0")
list_item_2 = ListItem(List=tableuiadaptercomponent.Variables, Index="1", Wrap=True)
remap_numbers_2 = RemapNumbers(Value=list_item_2, Source=construct_domain_3, Target=construct_domain_4)  # -> Mapped, Clipped

# ---- group: quick+dirty smoothing
c_script = CSharpScript(incomingData=tableuiadaptercomponent.Models)  # -> out, outgoingData; inputs incomingData: list of Brep
# ---------- c_script: C# ----------
    if (incomingData == null)
    {
      outgoingData = savedData;
    }
    else
    {
      outgoingData = incomingData;
      savedData = incomingData;
    }
# ---------- c_script: C# additional code ----------
  private List<Brep> savedData;
# ---------- end c_script ----------

# ----
panel_2 = Panel(tableuiadaptercomponent.Variables)
vector_xyz = VectorXYZ(XComponent=0, YComponent=0, ZComponent=remap_numbers_2.Mapped)  # -> Vector, Length
panel_3 = Panel(c_script.outgoingData)
brep_2 = Brep(c_script.outgoingData)
move = Move(Geometry=brep_2, Motion=vector_xyz.Vector)  # -> Geometry, Transform

# ---- group: change the color according to the variable
construct_domain_5 = ConstructDomain(DomainStart="0", DomainEnd="180")
construct_domain_6 = ConstructDomain(DomainStart="0", DomainEnd="255")
list_item_3 = ListItem(List=tableuiadaptercomponent.Variables, Index="0", Wrap=True)
remap_numbers_3 = RemapNumbers(Value=list_item_3, Source=construct_domain_5, Target=construct_domain_6)  # -> Mapped, Clipped
panel_4 = Panel(remap_numbers_3.Mapped)
colour_rgb = ColourRGB(Alpha=255, Red=remap_numbers_3.Mapped, Green=remap_numbers.Mapped, Blue="100")
custom_preview = CustomPreview(Geometry=move.Geometry, Material=colour_rgb)
