# Grasshopper definition gh_testSite_options.gh (Grasshopper 1.0.7)
# plug-ins: TableUiAdapter

# https://magpietable-default-rtdb.firebaseio.com/.json
toggle = BooleanToggle(True)
trigger = Trigger(Interval=-1000, TimerInterval=1000, Target=tableui)
tableui = TableUiAdapterComponent(Link="5005", Run=toggle, RepoStrategy="udp")  # -> Ids, Points, Rotation
pt = Point(tableui.Points)
