# Grasshopper definition startuptest.gh (Grasshopper 1.0.7)
# plug-ins: TableUiAdapter

tableuireceiver = TableUIReceiver()  # -> MarkerIDs, MarkerRotations, MarkerLocations, Counter
panel = Panel(tableuireceiver.MarkerIDs)
panel_2 = Panel(tableuireceiver.MarkerRotations)
panel_3 = Panel(tableuireceiver.MarkerLocations)
panel_4 = Panel(tableuireceiver.Counter)
